# Grasshopper definition test.gh (Grasshopper 1.0.7)
# plug-ins: FloorPlanGenerator, MeshEdit Components

curve = Curve(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)
point = Point(Point(6.359421247, -4.457145937, 0))
houseinstance = HouseInstance(Boundary=curve, EntrancePoint=point)
roominstance = RoomInstance()
roominstance_2 = RoomInstance()
roominstance_3 = RoomInstance()
number_slider = Slider(5, range=0..10)
roominstance_4 = RoomInstance()

# ---- group: 可以变更方案用
trigger = Trigger(Interval=100, TimerInterval=100, Target=magnetizingrooms_heapes)  # disabled

# ----
magnetizingrooms_heapes = MagnetizingRooms_HeapES(
    HouseInstance=houseinstance,
    Iterations=Slider(200, range=0..1000),
    MaxAdjDistance=Slider(3, range=0..10),
    DisplayNumber=number_slider,
    GapOfResult=Slider(1, range=0..10))  # -> Corridors, RoomBreps, RoomNames, Adjacencies, MissingAdjacences

# ---- group: 水平查看所有方案，可通过slider控制距离
unit_x = UnitX(Factor=Slider(33, range=0..100))
series = Series(Start=0, Step=1, Count=number_slider)
multiplication = Multiplication(A=unit_x, B=series)
move = Move(Geometry=magnetizingrooms_heapes.Corridors, Motion=graft(multiplication))  # -> Geometry, Transform
move_2 = Move(Geometry=magnetizingrooms_heapes.RoomBreps, Motion=graft(multiplication))  # -> Geometry, Transform
cluster = Cluster(
    brep_2=move.Geometry,
    brep=move_2.Geometry,
    txt_2=magnetizingrooms_heapes.RoomNames,
    txt=magnetizingrooms_heapes.Adjacencies,
    int=magnetizingrooms_heapes.MissingAdjacences)

# ---- group: 获取第n号方案进行立面深化
number_slider_2 = Slider(0, range=0..10)
tree_branch = TreeBranch(Tree=magnetizingrooms_heapes.RoomNames, Path=number_slider_2, MaintainPaths=True)
tree_branch_2 = TreeBranch(Tree=magnetizingrooms_heapes.RoomBreps, Path=number_slider_2, MaintainPaths=True)
tree_branch_3 = TreeBranch(Tree=magnetizingrooms_heapes.Adjacencies, Path=number_slider_2, MaintainPaths=True)
tree_branch_4 = TreeBranch(Tree=magnetizingrooms_heapes.Corridors, Path=number_slider_2, MaintainPaths=True)
tree_branch_5 = TreeBranch(Tree=magnetizingrooms_heapes.MissingAdjacences, Path=number_slider_2, MaintainPaths=True)

# ---- group: 过程
brep = Brep(tree_branch_4)
brep_2 = Brep(tree_branch_2)
edges = BrepEdges(Brep=brep_2)  # -> Naked, Interior, NonManifold
area = MeshArea(Mesh=brep_2)  # -> Area, Centroid
join = BrepJoin(Breps=flatten([brep, brep_2]))  # -> Breps, Closed
edges_2 = BrepEdges(Brep=join.Breps)  # -> Naked, Interior, NonManifold
crv = Curve(edges_2.Naked)

# ---- group: 数量一定要大于4*3*roomCount
genes = GenePool(Decimals=1, Maximum=1, Minimum=0.1, Value=[0.6, 0.1, 0.6, 0.6, 0.3, 0.6, 0.1, 0.1, 0.2, 0.6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])

# ---- group: 调整fitness
number_slider_3 = Slider(1, range=0..10)
number_slider_4 = Slider(4.2, range=0..10)
number_slider_5 = Slider(1.8, range=0..10)

# ---- group: 该列表一定要房间数量匹配
panel = Panel("""4
2
3
2""")

# ---- group: 遗传算法主程序
c_script = CSharpScript(
    boundary=crv,
    roomsBoundary=edges.Naked,
    centerPoint=area.Centroid,
    roomName=tree_branch,
    roomDaylightFactor=panel,
    genePool=genes,
    control_y1=number_slider_4,
    control_kc=number_slider_5,
    control_gc=number_slider_3)  # -> out, A, B, FloorPolyLines, y1, Kc, Gc, Fitness; inputs boundary: list of Line, roomsBoundary: tree of Line, centerPoint: list of Point3d, roomName: list of String, roomDaylightFactor: list of Double, genePool: list of Double, control_y1: Double, control_kc: Double, control_gc: Double
# ---------- c_script: C# usings ----------
using System.Linq;
# ---------- c_script: C# ----------
    A = ClassifyLines(boundary, roomsBoundary);

    List<Wall> walls = new List<Wall>();
    walls = GetWalls(ClassifyLines(boundary, roomsBoundary), centerPoint, roomName);

    List<Line> north = new List<Line>();

    //List<Line> lines = walls.Branch(0).Where(x => x.Direction == Direction.North).Select(x => x.Line).ToList();

    List<Line> lines = walls.Where(x => x.Direction != Direction.Unset).Where(x => x.RoomName == "Room 0").Select(x => x.Line).ToList();

    B = lines;


    Floor floor = new Floor(walls, roomName, roomDaylightFactor, genePool);
    floor.Fitness = floor.DataProcess(control_y1, control_kc, control_gc);


    FloorPolyLines = floor.FloorPolylines;

    y1 = floor.Y1;
    Kc = floor.KC;
    Gc = floor.GC;
    Fitness = floor.Fitness;
# ---------- c_script: C# additional code ----------
  public DataTree<Line> ClassifyLines(List<Line> boundary, DataTree<Line> roomsBoundary)
  {
    DataTree<Line> classifyLines = new DataTree<Line>();


    for (int i = 0; i < roomsBoundary.BranchCount; i++)
    {
      List<Line> lines = new List<Line>();
      for (int j = 0; j < roomsBoundary.Branches[i].Count; j++)
      {
        for (int k = 0; k < boundary.Count; k++)
        {
          if (IsSameLine(boundary[k], roomsBoundary.Branches[i][j]))
          {
            lines.Add(boundary[k]);
          }
        }
      }
      classifyLines.AddRange(lines, new GH_Path(i));

    }
    return classifyLines;
  }

  public bool IsSameLine(Line a, Line b)
  {
    return (a.From == b.From && a.To == b.To) || (a.From == b.To && a.To == b.From);
  }


  public enum Direction{ Unset,South, West,North,East};

  public Direction GetDirection(Point3d centerPoint, Line line)
  {
    Point3d pointA = line.From;
    Point3d pointB = line.To;

    if(pointA.X == pointB.X && pointA.X < centerPoint.X)
      return Direction.West;
    else if (pointA.X == pointB.X && pointA.X >= centerPoint.X)
      return Direction.East;
    else if(pointA.Y == pointB.Y && pointA.Y >= centerPoint.Y)
      return Direction.North;
    else if(pointA.Y == pointB.Y && pointA.Y < centerPoint.Y)
      return Direction.South;
    else
      return Direction.Unset;
  }


  public List<Wall> GetWalls (DataTree<Line> lines, List<Point3d> centerPoint, List<string> names)
  {
    List<Wall> result = new List<Wall>();

    for (int i = 0; i < lines.BranchCount; i++)
    {
      List<Wall> walls = new List<Wall>();

      for (int j = 0; j < lines.Branches[i].Count; j++)
      {
        Wall wall = new Wall();
        wall.RoomName = names[i];
        wall.Line = lines.Branches[i][j];
        wall.Direction = GetDirection(centerPoint[i], wall.Line);

        walls.Add(wall);
      }

      result.AddRange(walls);
    }
    return result;
  }


  public class Wall
  {
    public Line Line = new Line();
    public Direction Direction ;
    public string RoomName = "";

  }



  //根据采光系数表，得到的一个矩阵（进深4.8m, 层高3.0m）的数值，根据这个矩阵，用采光系数与Kc值，算出Gc值
  public static double[,] CavMatrix =
    {
    { 1.3, 1.6, 1.9,2.1,2.3 },
    {1.8,2.2,2.6,2.9,3.2 },
    {2.2,2.7,3.1,3.5,3.9 },
    {2.7,3.2,3.7,4.2,4.7 }
    };

  public class Floor
  {
    public List<Wall> WestWall;
    public List<Wall> NorthWall;
    public List<Wall> EastWall;
    public List<Wall> SouthWall;

    public List<string> RoomName;

    public List<double> DayLightFactor;
    public List<double> GenePool;

    public double Fitness;

    public DataTree<Polyline> FloorPolylines;
    public DataTree<double> Y1;
    public DataTree<double> KC;
    public DataTree<double> GC;

    public Floor(List<Wall> walls, List<string> roomName, List<double> dayLightFactor, List<double> genePool)
    {
      WestWall = walls.Where(x => x.Direction == Direction.West).Select(x => x).ToList();
      NorthWall = walls.Where(x => x.Direction == Direction.North).Select(x => x).ToList();
      EastWall = walls.Where(x => x.Direction == Direction.East).Select(x => x).ToList();
      SouthWall = walls.Where(x => x.Direction == Direction.South).Select(x => x).ToList();

      RoomName = roomName;
      DayLightFactor = dayLightFactor;
      GenePool = genePool;

      FloorPolylines = GetLinesInEachDirection();

    }

    public DataTree<Polyline> GetLinesInEachDirection()
    {
      DataTree<Polyline> result = new DataTree<Polyline>();


      result.AddRange(GetLinesByNames(WestWall), new GH_Path(0));
      result.AddRange(GetLinesByNames(NorthWall), new GH_Path(1));
      result.AddRange(GetLinesByNames(EastWall), new GH_Path(2));
      result.AddRange(GetLinesByNames(SouthWall), new GH_Path(3));

      return result;
    }


    public List<Polyline> GetLinesByNames(List<Wall> walls)
    {
      List<Polyline> result = new List<Polyline>();

      foreach (string name in RoomName)
      {
        Polyline polyline = new Polyline(); // 合并后的多段线
        // 用于存储已添加的点的集合
        HashSet<Point3d> addedPoints = new HashSet<Point3d>();
        for (int i = 0; i < walls.Count; i++)
        {
          if (name == walls[i].RoomName)
          {
            var line = walls[i].Line;

            Point3d startPoint = line.From;
            Point3d endPoint = line.To;

            // 检查起点是否已添加
            if (!addedPoints.Contains(startPoint))
            {
              addedPoints.Add(startPoint);
            }
            // 检查终点是否已添加
            if (!addedPoints.Contains(endPoint))
            {
              addedPoints.Add(endPoint);
            }
          }
        }
        List<Point3d> sortedPoints = addedPoints.OrderBy(point => point.X).ThenBy(point => point.Y).ToList();
        polyline.AddRange(sortedPoints);
        polyline = polyline.Count > 0 ? polyline : null;

        result.Add(polyline);
      }
      return result;
    }


    public List<List<double>> SplitGroup(List<double> elements, int group, int chunkSize)
    {
      List<List<double>> subLists = new List<List<double>>();
      for (int i = 0; i < group; i++)
      {
        List<double> subList = elements.Skip(i * chunkSize).Take(chunkSize).ToList();
        subLists.Add(subList);
      }

      return subLists;
    }

    public static double Remap(double value, double fromLow, double fromHigh, double toLow, double toHigh)
    {
      // 确保输入值在源区间内
      value = Math.Max(Math.Min(value, fromHigh), fromLow);

      // 计算百分比
      double fromRange = fromHigh - fromLow;
      double toRange = toHigh - toLow;
      double percent = (value - fromLow) / fromRange;

      // 应用映射
      double remappedValue = toLow + percent * toRange;

      // 四舍五入到一位小数
      return Math.Round(remappedValue, 1);
    }

    public double DataProcess(double multipl_y1, double multipl_kc, double multipl_gc)
    {
      double fitness = 0;

      List<List<double>> subLists = SplitGroup(GenePool, 3, RoomName.Count * 4);

      //拆成y1,Kc, Gc三组
      List<double> paraY1 = subLists[0];
      List<double> paraKc = subLists[1];
      List<double> paraGc = subLists[2];

      //y1的取值范围[0.6, 1.6]
      List<double> y1 = paraY1.Select(x => Remap(x, 0.1, 1, 0.6, 1.6)).ToList();
      //kc的取值范围[0.5, 0.9]
      List<double> Kc = paraKc.Select(x => Remap(x, 0.1, 1, 0.5, 0.9)).ToList();
      //gc的取值范围[0.3, 0.6]
      List<double> Gc = paraGc.Select(x => Remap(x, 0.1, 1, 0.3, 0.6)).ToList();

      //Y1:距离地面高度
      Y1 = ConvertToTree(SplitGroup(y1, 4, RoomName.Count));
      //KC:侧面采光的窗宽系数，为窗宽度与房间宽度之比
      KC = ConvertToTree(SplitGroup(Kc, 4, RoomName.Count));
      //GC:侧面采光的窗高系数，为窗高度与层高之比
      GC = ConvertToTree(SplitGroup(Gc, 4, RoomName.Count));


      List<List<double>> eachDirection = SplitGroup(Kc, 4, RoomName.Count);

      fitness = multipl_kc * (CalculateWest(eachDirection[0]) + CalculateNorth(eachDirection[1]) +
        CalculateEast(eachDirection[2]) + CalculateSouth(eachDirection[3])) +
        multipl_y1 * CalculateHeight(Y1) +
        multipl_gc * CalculateRoomDaylightFactor(GC, KC);


      return fitness;
    }


    public DataTree<double> ConvertToTree(List<List<double>> listValue)
    {
      DataTree<double> result = new DataTree<double>();

      for (int i = 0; i < listValue.Count; i++)
      {
        result.AddRange(listValue[i], new GH_Path(i));
      }

      return result;
    }

    public double CalculateWest(List<double> values)
    {
      double score = 0.0;
      //西侧的墙
      List<Polyline> pls = FloorPolylines.Branch(0);

      for (int i = 0; i < pls.Count; i++)
      {
        if (pls[i] != null)
        {
          if (values[i] == 0.9)
            score += 1;
          else if (values[i] == 0.8)
            score += 2;
          else if (values[i] == 0.7)
            score += 3;
          else if (values[i] == 0.6)
            score += 4;
          else if (values[i] == 0.5)
            score += 5;
          else
            score += 0;
        }
      }
      return score;
    }

    public double CalculateNorth(List<double> values)
    {
      double score = 0.0;
      //北侧的墙
      List<Polyline> pls = FloorPolylines.Branch(1);

      for (int i = 0; i < pls.Count; i++)
      {
        if (pls[i] != null)
        {
          if (values[i] == 0.9)
            score += 5;
          else if (values[i] == 0.8)
            score += 4;
          else if (values[i] == 0.7)
            score += 3;
          else if (values[i] == 0.6)
            score += 2;
          else if (values[i] == 0.5)
            score += 1;
          else
            score += 0;
        }
      }
      return score;
    }

    public double CalculateEast(List<double> values)
    {
      double score = 0.0;
      //东侧的墙
      List<Polyline> pls = FloorPolylines.Branch(2);

      for (int i = 0; i < pls.Count; i++)
      {
        if (pls[i] != null)
        {
          if (values[i] == 0.9)
            score += 1;
          else if (values[i] == 0.8)
            score += 2;
          else if (values[i] == 0.7)
            score += 3;
          else if (values[i] == 0.6)
            score += 2;
          else if (values[i] == 0.5)
            score += 1;
          else
            score += 0;
        }
      }
      return score;
    }

    public double CalculateSouth(List<double> values)
    {
      double score = 0.0;
      //南侧的墙
      List<Polyline> pls = FloorPolylines.Branch(3);

      for (int i = 0; i < pls.Count; i++)
      {
        if (pls[i] != null)
        {
          if (values[i] == 0.9)
            score += 5;
          else if (values[i] == 0.8)
            score += 4;
          else if (values[i] == 0.7)
            score += 3;
          else if (values[i] == 0.6)
            score += 2;
          else if (values[i] == 0.5)
            score += 1;
          else
            score += 0;
        }
      }
      return score;
    }


    public double CalculateHeight(DataTree<double> values)
    {
      double score = 0.0;

      for (int i = 0; i < FloorPolylines.BranchCount; i++)
      {
        List<Polyline> pls = FloorPolylines.Branch(i);

        for (int j = 0; j < pls.Count; j++)
        {
          if (pls[j] != null)
          {
            if (values.Branch(i)[j] < 1.2)
              score += 1;
            else if (values.Branch(i)[j] == 1.2)
              score += 5;
            else if (values.Branch(i)[j] == 1.3)
              score += 4;
            else if (values.Branch(i)[j] == 1.4)
              score += 3;
            else if (values.Branch(i)[j] > 1.4)
              score += 1;
            else
              score += 0;
          }
        }
      }
      return score;
    }


    public double CalculateRoomDaylightFactor(DataTree<double> gcValues, DataTree<double> kcValues)
    {
      double score = 0.0;


      for (int i = 0; i < FloorPolylines.BranchCount; i++)
      {
        List<Polyline> pls = FloorPolylines.Branch(i);

        for (int j = 0; j < pls.Count; j++)
        {
          if (pls[j] != null)
          {
            double daylightFactor = CavMatrix[RemapGC(gcValues.Branch(i)[j]), RemapKC(kcValues.Branch(i)[j])];

            //算出在y1，gc的条件下，窗最终的高度
            var totalHeight = Y1.Branch(i)[j] + 2.8 * gcValues.Branch(i)[j];
            //如果在正常范围内，低于floor0.3m
            if (totalHeight <= 2.8 - 0.3)
              score += CalculateScore(5, daylightFactor, DayLightFactor[j]);
              //如果窗户高于层高，总分递减，不应该出现这种错误场景
            else
              score -= 50 * (totalHeight - 2.5);
          }
        }

      }
      return score;
    }


    int RemapKC(double kc)
    {
      if (kc == 0.5)
        return 0;
      if (kc == 0.6)
        return 1;
      if (kc == 0.7)
        return 2;
      if (kc == 0.8)
        return 3;
      if (kc == 0.9)
        return 4;
      return 0;
    }

    int RemapGC(double gc)
    {
      if (gc == 0.3)
        return 0;
      if (gc == 0.4)
        return 1;
      if (gc == 0.5)
        return 2;
      if (gc == 0.6)
        return 3;
      return 0;
    }
    public static double CalculateScore(double score, double x, double a)
    {
      //x:根据gc与kc算出来的采光系数
      //a:该房间类型应该的采光系数，是一个用户输入值
      // 计算x与a的差值
      double difference = Math.Abs(x - a);

      // 如果差值在0.5之内，得分为score分
      if (difference <= 0.5)
      {
        return score;
      }
      else
      {
        // 否则，根据距离远近逐渐减少得分
        // 这里使用一个简单的线性减分逻辑，您可以根据需要调整
        double maxScore = score; // 最大得分
        double minScore = -score; // 最小得分
        double maxDifference = 2.0; // 最大差值，根据需要调整

        // 计算得分，使用线性插值
        double value = Math.Round(maxScore - (difference / maxDifference) * (maxScore - minScore));

        return value;
      }
    }

  }
# ---------- end c_script ----------

# ---- group: 如果改层高，代码里也要改
# boundary: 户型外轮廓
# roomsBoundary: 每一个房间的外轮廓
# centerPoint: 每个房间的中心点
# roomName: 每个房间的名字
# roomDaylightFactor: 每个房间的期望达到的采光系数, 数量一定要与房间数量一致，不然报错
# genePool: 基因池，取值范围: [0.1,1], 数量应该大于4 (西北东南) * 3(y1, kc, gc) * roomCount, 不然会报错
# control_y1: 控制最终fitness的y1部分的数乘系数
# control_kc: 控制最终fitness的kc部分的数乘系数
# control_gc: 控制最终fitness的gc部分的数乘系数
number_slider_6 = Slider(2.8, range=0..10)

# ----
# 遗传算法的评分已经根据word规则写入了程序中，如果想更改评分，可去如下地方修改：Floor类
# 
# 可以更改如下几个函数：
# CalculateWest
# CalculateNorth
# CalculateEast
# CalculateSouth (更改kc)
# 
# CalculateHeight  (更改y1)
# 
# CalculateRoomDaylightFactor  (根据采光系数矩阵，每个房间越靠近采光系数，得分越高)
# 
# 以上几个函数进行修改
# 
# 
# 最终综合影响fitness值
galapagos = Galapagos(fitness=c_script, gene=genes)
join_2 = JoinCurves(Curves=crv, Preserve=False)
Z = UnitZ(Factor=number_slider_6)
panel_2 = Panel(c_script.Fitness)

# ---- group: 根据y1,kc,gc生成窗户
cluster_2 = Cluster_2(crv=c_script.FloorPolyLines, F=c_script.y1, A_2=c_script.Kc, A=number_slider_6, B=c_script.Gc)

# ----
extr = Extrude(Base=join_2, Direction=Z)
boundary = BoundarySurfaces(Edges=cluster_2)
panel_3 = Panel(c_script.y1)
panel_4 = Panel(c_script.Kc)
panel_5 = Panel(c_script.Gc)

# ==== cluster Cluster
txt = ClusterInput()
txt_2 = ClusterInput()
brep = ClusterInput()
brep_2 = ClusterInput()
int = ClusterInput()
txt_3 = Text(txt)
txt_4 = Text(txt_2)
brep_3 = Brep(brep)
brep_4 = Brep(brep_2)
int_2 = Integer(int)
txt_5 = Text(txt_4)
trim = TextTrim(Text=txt_3, Start=True, End=True)
len = TextLength(Text=txt_5)
min = Minimum(A="8", B=len)
fragment = TextFragment(Text=txt_5, Start="0", Count=min)
tmatch = MatchText(Text=fragment, Pattern="&&HALL&&", Case=True)
long = LongestList(ListA=tmatch, ListB="0", ListC="8", PaddingMode=2)  # -> ListA, ListB, ListC
brep_5 = Brep(brep_4)
brep_6 = Brep(brep_3)

# ---- group: Connections display
split = TextSplit(Text=trim, Separators="-,")
trim_2 = TextTrim(Text=split, Start=True, End=True)  # -> simplify(Result)
lng = ListLength(List=trim_2)  # -> expr("x-1", Length)
cull_i = CullIndex(List=trim_2, Indices=lng, Wrap=False)
int_3 = Integer(split)
dispatch = Dispatch(List=int_3, DispatchPattern=[True, False])  # -> ListA, ListB
item = ListItem(List=brep_6, Index=expr("x", dispatch.ListA), Wrap=True)
item_2 = ListItem(List=brep_6, Index=expr("x", dispatch.ListB), Wrap=True)
center = Center(Geometrical=item)  # -> Center, Dimension
center_2 = Center(Geometrical=item_2)  # -> Center, Dimension
ln = Line(StartPoint=center.Center, EndPoint=center_2.Center)
previewlw = CustomPreviewLineweights(Geometry=ln, Shader=ColourSwatch(SwatchColor=RGB(43, 43, 43)), Thickness=Slider(0.051, range=0..1), Absolute=True)

# ----
p_n_c = PickNChoose(Pattern=tmatch, Stream0=long.ListB, Stream1=long.ListC)
fragment_2 = TextFragment(Text=txt_5, Start=p_n_c)
txt_6 = Text(fragment_2)

# ---- group: Missing Adj Dots display
equals = Equality(FirstNumber=int_2, SecondNumber=0)  # -> Equality, Inequality
cull = CullPattern(List=brep_6, CullPattern=equals.Inequality)
center_3 = Center(Geometrical=cull)  # -> Center, Dimension
cir = Circle(Plane=center_3.Center, Radius=0.45)
boundary = BoundarySurfaces(Edges=cir)
previewlw_2 = CustomPreviewLineweights(Geometry=boundary, Shader=ColourSwatch(SwatchColor=RGB(227, 0, 0)), Absolute=False)

# ---- group: Names & Centers display
bbox = BoundingBox(Content=brep_6, Plane=PlaneXY(0, 0, 0))  # -> Box, Box_2
box_corners = BoxCorners(Box=bbox.Box)  # -> CornerA, CornerB, CornerC, CornerD, CornerE, CornerF, CornerG, CornerH
center_4 = Center(Geometrical=brep_6)  # -> Center, Dimension
text = DefineText(Text=txt_6, Plane=box_corners.CornerA, Size=".5", Font="IBM Plex Sans Condensed Medium")
previewlw_3 = CustomPreviewLineweights(Geometry=[center_4.Center, text], Shader=ColourSwatch(SwatchColor=RGB(0, 0, 0)), Absolute=False)

# ---- group: Corridors display
hsl = ColourHSL(Alpha=1, Hue=0, Saturation=0, Luminance=Slider(1, range=0..1))
previewmat = CustomPreviewMaterials(Geometry=brep_5, DiffuseColor=hsl)

# ---- group: House Edges DISPLAY
join = BrepJoin(Breps=flatten([brep_5, brep_6]))  # -> Breps, Closed
edges = BrepEdges(Brep=join.Breps)  # -> Naked, Interior, NonManifold
number_slider = Slider(0.104, range=0..4)
crv = Curve(edges.Naked)
join_2 = JoinCurves(Curves=crv, Preserve=False)
offset = Offset(Curve=flatten(join_2), Distance=expr("x/2", number_slider), Plane=PlaneXY(0, 0, 0), Corners=1)
previewlw_4 = CustomPreviewLineweights(Geometry=flatten(offset), Shader=ColourSwatch(SwatchColor=RGB(0, 0, 0)), Thickness=number_slider, Absolute=True)

# ---- group: Room colors display
lng_2 = ListLength(List=brep_6)
division = Division(A=".5", B=lng_2)
series = Series(Start=0, Step=division, Count=lng_2)
addition = Addition(A=series, B=Slider(0.108, range=0..1))
long_2 = LongestList(ListA=tmatch, ListB=Slider(0.637, range=0..1), ListC="1", PaddingMode=2)  # -> ListA, ListB, ListC

# ----
p_n_c_2 = PickNChoose(Pattern=tmatch, Stream0=long_2.ListB, Stream1=long_2.ListC)

# ---- group: Room colors display (continued)
hsl_2 = ColourHSL(Alpha=1, Hue=addition, Saturation=1, Luminance=p_n_c_2)
previewmat_2 = CustomPreviewMaterials(Geometry=brep_6, DiffuseColor=hsl_2)

# ---- group: Rooms Edges DISPLAY
crv_2 = Curve(simplify(brep_6))
subtraction = Subtraction(A=hsl_2, B=ColourSwatch(SwatchColor=RGB(71, 71, 71)))  # -> simplify(Result)
previewlw_5 = CustomPreviewLineweights(Geometry=crv_2, Shader=subtraction, Thickness=Slider(0.049, range=0..4), Absolute=True)

# ==== cluster Cluster_2
F = ClusterInput()
crv = ClusterInput()
Z = UnitZ(Factor=F)
crv_2 = Curve(crv)
B = ClusterInput()
A = ClusterInput()
A_2 = ClusterInput()
number_slider = Slider(0.5, range=0..1)
multiplication = Multiplication(A=A, B=B)
move = Move(Geometry=crv_2, Motion=Z)  # -> Geometry, Transform
curvepoint = PointOnCurve(move.Geometry, parameter=0.5)
division = Division(A=A_2, B="2")
pdecon = Deconstruct(Point=curvepoint)  # -> XComponent, YComponent, ZComponent
addition = Addition(A=number_slider, B=division)
subtraction = Subtraction(A=number_slider, B=division)
addition_2 = Addition(A=pdecon.ZComponent, B=multiplication)
eval = EvaluateCurve(Curve=reparameterize(move.Geometry), Parameter=subtraction)  # -> Point, Tangent, Angle
pt = ConstructPoint(XCoordinate=pdecon.XComponent, YCoordinate=pdecon.YComponent, ZCoordinate=addition_2)
eval_2 = EvaluateCurve(Curve=reparameterize(move.Geometry), Parameter=addition)  # -> Point, Tangent, Angle
rec_3pt = Rectangle3Pt(PointA=eval_2.Point, PointB=eval.Point, PointC=pt)  # -> flatten(Rectangle), Length
null = NullItem(Item=rec_3pt.Rectangle)  # -> NullFlags, InvalidFlags, Description
not = GateNot(A=null.NullFlags)
cull = CullPattern(List=rec_3pt.Rectangle, CullPattern=not)
L = ClusterOutput(cull)
